# Grasshopper definition cone_to_creal_yarn_model.gh (Grasshopper 1.0.8)

# ---- group: Circle Setup
pt = Point(Point(0, 0, 0))
division = Division(A=Slider(100, range=0..200), B=2)
cir = Circle(Plane=pt, Radius=division)

# ---- group: Line Setup
Z = UnitZ(Factor=1)
Z_2 = UnitZ(Factor=Slider(152.8, range=0..1000))
move = Move(Geometry=pt, Motion=Z_2)  # -> Geometry, Transform
line = LineSDL(Start=move.Geometry, Direction=Z, Length=Slider(0, range=0..100))

# ---- group: Rim Point
eval = EvaluateCurve(Curve=reparameterize(cir), Parameter=Slider(0.099, range=0..1))  # -> Point, Tangent, Angle

# ---- group: Connecting Curve
biarc = BiArc(StartPoint=eval.Point, StartTangent=eval.Tangent, EndPoint=move.Geometry, EndTangent=Z, Ratio=Slider(0.439, range=0..1))  # -> FirstArc, SecondArc, BiArc
