# Grasshopper definition grasshopper_to_place_cone.gh (Grasshopper 1.0.8)

number_slider = Slider(44.6, range=0..1000)
pt = Point(Point(0, 0, 0))
number_slider_2 = Slider(150, range=0..5000)
number_slider_3 = Slider(406.4, range=0..1000)
number_slider_4 = Slider(4, range=1..50)
number_slider_5 = Slider(339.6, range=0..1000)
number_slider_6 = Slider(2679.7, range=0..5000)
brep = Brep(<brep referenced from the Rhino model>)
pt_2 = Point(Point(2409.247621, 1159.851361, 1369.105749))
pt_3 = Point(Point(2409.247621, 943.7312349, 2083.044141))
number_slider_7 = Slider(2, range=1..50)
division = Division(A=number_slider_5, B="2")
pt_4 = Point(Point(3279.61159, 943.7312349, 2.058135835))
cluster = Cluster(
    relay_2=number_slider_3,
    Y=number_slider_6,
    N=number_slider_5,
    C=number_slider_4,
    relay_3=number_slider_2,
    B_2=division,
    G=brep,
    A=pt,
    relay=number_slider,
    B=pt_3)  # -> L, out_cone_centroid_bottoms, out_cones, out_rectangle
cluster_2 = Cluster(
    relay_2=number_slider_3,
    Y=number_slider_6,
    N=number_slider_5,
    C=number_slider_4,
    relay_3=number_slider_2,
    B_2=division,
    G=brep,
    A=pt,
    relay=number_slider,
    B=pt_2)  # -> L, out_cone_centroid_bottoms, out_cones, out_rectangle
merge = Merge(
    Data1=number_slider_3,
    Data2=number_slider_4,
    Data3=number_slider_6,
    Data4=number_slider_6,
    Data5=number_slider_2,
    Data6=number_slider,
    Data7=number_slider_7)
cluster_3 = Cluster(
    relay_2=number_slider_3,
    Y=number_slider_6,
    N=number_slider_5,
    C=number_slider_7,
    relay_3=number_slider_2,
    B_2=division,
    G=brep,
    A=pt,
    relay=number_slider,
    B=pt_4)  # -> L, out_cone_centroid_bottoms, out_cones, out_rectangle
merge_2 = Merge(Data1=cluster_2.out_cones, Data2=cluster.out_cones, Data3=cluster_3.out_cones)  # -> flatten(Result)
panel = Panel(cluster_2.L)
panel_2 = Panel(cluster.L)
panel_3 = Panel(cluster_3.L)
flatten = FlattenTree(Tree=merge_2, Path="{0}")
panel_4 = Panel(cluster_3.out_cones)
py3 = Python3Script(geometry=flatten(flatten), trigger=merge)  # -> out, a; inputs geometry: tree
# ---------- py3: Python ----------
from Grasshopper import DataTree
import Rhino
import Rhino.Geometry as rg
import scriptcontext as sc
import System
import struct
import os
import sys

# Get all items from tree
geo_list = []
if hasattr(geometry, 'Branches'):
    for branch in geometry.Branches:
        for item in branch:
            geo_list.append(item)

# Skip if nothing changed
geo_count = len(geo_list)
last_count = sc.sticky.get("last_geo_count", -1)
if geo_count == last_count:
    a = sc.sticky.get("last_stl_path", "")
    print("No change, skipping export")
else:
    sc.sticky["last_geo_count"] = geo_count

    # Build combined mesh
    stl_path = "C:/temp/cones.stl"
    mesh_list = rg.Mesh()

    for geo in geo_list:
        if isinstance(geo, System.Guid):
            rhino_obj = sc.doc.Objects.FindId(geo)
            if rhino_obj:
                brep = rhino_obj.Geometry
                meshes = rg.Mesh.CreateFromBrep(brep, rg.MeshingParameters.Default)
                for m in meshes:
                    mesh_list.Append(m)

    # Build triangle list
    triangles = []
    for i in range(mesh_list.Faces.Count):
        face = mesh_list.Faces[i]
        v0 = mesh_list.Vertices[face.A]
        v1 = mesh_list.Vertices[face.B]
        v2 = mesh_list.Vertices[face.C]
        triangles.append((v0, v1, v2))

    # Write STL
    os.makedirs(os.path.dirname(stl_path), exist_ok=True)
    with open(stl_path, 'wb') as f:
        f.write(b'\0' * 80)
        f.write(struct.pack('<I', len(triangles)))
        for v0, v1, v2 in triangles:
            f.write(struct.pack('<fff', 0, 0, 0))
            f.write(struct.pack('<fff', v0.X, v0.Y, v0.Z))
            f.write(struct.pack('<fff', v1.X, v1.Y, v1.Z))
            f.write(struct.pack('<fff', v2.X, v2.Y, v2.Z))
            f.write(struct.pack('<H', 0))

    print(f"Exported {len(geo_list)} cones to {stl_path}")

    # Send to RoboDK
    try:
        sys.path.append("C:/RoboDK/Python")
        from robodk.robolink import Robolink

        RDK = Robolink()
        
        # Remove previous object if it exists
        prev = RDK.Item("cones")
        if prev.Valid():
            prev.Delete()
        
        # Load new STL
        RDK.AddFile(stl_path)
        print("Loaded into RoboDK")
    except Exception as e:
        print(f"RoboDK error: {e}")

    sc.sticky["last_stl_path"] = stl_path
    a = stl_path
# ---------- end py3 ----------
addition = Addition(A=cluster_2.L, B=cluster.L, C=cluster_3.L)
panel_5 = Panel(flatten)
panel_6 = Panel(addition)
panel_7 = Panel(py3.out)

# ==== cluster Cluster
relay = ClusterInput()
relay_2 = ClusterInput()
relay_3 = ClusterInput()
A = ClusterInput()
B = ClusterInput()
N = ClusterInput()
C = ClusterInput()
B_2 = ClusterInput()
Y = ClusterInput()
vec2pt = Vector2Pt(PointA=A, PointB=B, Unitize=False)  # -> Vector, Length
series = Series(Start=0, Step=N, Count=C)
pt = ConstructPoint(XCoordinate=relay, YCoordinate=relay_3, ZCoordinate=0)
subtraction = Subtraction(A=relay_2, B=relay)
addition = Addition(A=relay_3, B=B_2)
rectangle = Rectangle(Plane=PlaneXY(0, 0, 0), XSize=relay_2, YSize=Y, Radius=0)  # -> Rectangle, Length
pt_2 = ConstructPoint(XCoordinate=subtraction, YCoordinate=addition, ZCoordinate=0)
Y_2 = UnitY(Factor=series)
move = Move(Geometry=rectangle.Rectangle, Motion=vec2pt.Vector)  # -> Geometry, Transform
merge = Merge(Data1=pt, Data2=pt_2)
move_2 = Move(Geometry=graft(merge), Motion=Y_2)  # -> Geometry, Transform
G = ClusterInput()
move_3 = Move(Geometry=move_2.Geometry, Motion=vec2pt.Vector)  # -> flatten(Geometry), Transform
move_4 = Move(Geometry=G, Motion=move_3.Geometry)  # -> Geometry, Transform
lng = ListLength(List=flatten(move_4.Geometry))
L = ClusterOutput(lng)
out_rectangle = ClusterOutput(move.Geometry)
out_cone_centroid_bottoms = ClusterOutput(move_3.Geometry)
out_cones = ClusterOutput(move_4.Geometry)
